# Grasshopper definition 002_Rhino.Geometry.Intersect.Intersection.BrepPlane_in_Python_and_C#.ghx (Grasshopper 1.0.7)

# ---- group: Intersection Python vs C#
# 002_Rhino.Geometry.Intersect.Intersection.BrepPlane in Python and C#
pt = Point(Point(0.4803161406, -6.789034249, 0))
pt_2 = Point(Point(29.85845098, -36.04061826, 20.56484654))
pt_3 = Point(Point(62.41922357, -16.17140079, 0))
pt_4 = Point(Point(34.16288846, 20.58780152, 20.56484654))
python = GhPythonScript(pt1=pt, pt2=pt_2, pt3=pt_3, pt4=pt_4, move_plane_z=Slider(9.14, range=-3..40))  # -> out, brep, pln, port, success, crvs, pts; inputs pt1: Point3d, pt2: Point3d, pt3: Point3d, pt4: Point3d
# ---------- python: Python ----------
import Rhino.Geometry as rg


#https://developer.rhino3d.com/api/RhinoCommon/html/T_Rhino_Geometry_Intersect_Intersection.htm

brep = rg.Brep.CreateFromCornerPoints(pt1, pt2, pt3, pt4, 0.1)

pln = rg.Plane(rg.Point3d(0,0,move_plane_z), rg.Vector3d(0,0,1))

success = rg.Intersect.Intersection.BrepPlane(brep, pln, 0.001)[0]
crvs = rg.Intersect.Intersection.BrepPlane(brep, pln, 0.001)[1]
pts = rg.Intersect.Intersection.BrepPlane(brep, pln, 0.001)[2]
# ---------- end python ----------
panel = Panel(python.success)
panel_2 = Panel(python.crvs)
panel_3 = Panel(python.pts)
c_script = CSharpScript(B=python.brep, P=python.pln)  # -> out, crvs, pts; inputs B: Brep, P: Plane
# ---------- c_script: C# ----------
    // Algorithm
    Curve[] sections;
    Point3d[] intersects;
    bool success = Rhino.Geometry.Intersect.Intersection.BrepPlane(B, P, 0.001, out sections, out intersects);
    if (success)
    {
      Print("Intersection worked!");
    }
    else
    {
      Print("Intersection failed!");
    }

    // Outputs
    crvs = sections;
    pts = intersects;
# ---------- end c_script ----------
panel_4 = Panel(c_script.out)
panel_5 = Panel(c_script.crvs)
panel_6 = Panel(c_script.pts)
