# Grasshopper definition 003_managing_trees_and_nested_list___Using_JoinCurve_method.ghx (Grasshopper 1.0.7)

# ----
# 003_managing_trees_and_nested_list___Using_JoinCurve_method
data = Data(simplify(Tree({0}: [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], {1}: [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], {2}: [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], {3}: [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], {4}: [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], {5}: [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])))
panel = Panel(data)
python = GhPythonScript(cross_tot=data)  # -> out, lines_tot; inputs cross_tot: tree of Curve
# ---------- python: Python ----------
import Rhino.Geometry as rg
from ghpythonlib import treehelpers as th

cross_tot = th.tree_to_list(cross_tot, None)

lines_tot = []
for cross_branch in cross_tot:
    lines_branches = []
    poly = rg.Curve.JoinCurves(cross_branch)
    lines_branches.append(poly)
    lines_tot.append(lines_branches)
#    for line in cross_branch:
#         
#        lines_branches.append(line)
#    lines_tot.append(lines_branches)

lines_tot = th.list_to_tree(lines_tot)
# ---------- end python ----------
crv = Curve(flatten(python.lines_tot))
item = ListItem(List=crv, Index=Slider(0, range=0..5), Wrap=False)
panel_2 = Panel(python.lines_tot)
