# Grasshopper definition 004_using_zip_to_create_two_sets_of_circles.ghx (Grasshopper 1.0.7)

# ----
# 004_using_zip_to_create_two_sets_of_circles
pt = Point([Point(0.2, 0, 0), Point(0.1618033987, 0.1175570507, 0), Point(0.06180339164, 0.1902113056, 0), Point(-0.06180339733, 0.1902113038, 0), Point(-0.1618033994, 0.1175570497, 0), Point(-0.2, 0, 0), Point(-0.1618033987, -0.1175570507, 0), Point(-0.06180339164, -0.1902113056, 0), Point(0.06180339733, -0.1902113038, 0), Point(0.1618033994, -0.1175570497, 0)])
pt_2 = Point([Point(0.4, 0, 3), Point(0.3236067973, 0.2351141015, 3), Point(0.1236067833, 0.3804226112, 3), Point(-0.1236067947, 0.3804226075, 3), Point(-0.3236067988, 0.2351140995, 3), Point(-0.4, 0, 3), Point(-0.3236067973, -0.2351141015, 3), Point(-0.1236067833, -0.3804226112, 3), Point(0.1236067947, -0.3804226075, 3), Point(0.3236067988, -0.2351140995, 3)])
python = GhPythonScript(pts1=pt, pts2=pt_2)  # -> out, cs1, cs2, dist1, dist2; inputs pts1: list of Point3d, pts2: list of Point3d
# ---------- python: Python ----------
import Rhino.Geometry as rg

#cs1 and cs2 are the list that will contain the small circles on the bottom and top
cs1 = []
cs2 = []

#dist1 is the distance between two points in the list pts1 divided by 2.
#It will be used as radius to generate the small circles. dist2 is the same
#but for the top of the column

dist1 = (rg.Point3d.DistanceTo(pts1[0],pts1[1])) / 2
dist2 = (rg.Point3d.DistanceTo(pts2[0],pts2[1])) / 2

for p1, p2 in zip(pts1, pts2):
    c1 = rg.Circle(p1, dist1)
    cs1.append(c1)
    c2 = rg.Circle(p2, dist2)
    cs2.append(c2)
# ---------- end python ----------
circle = Circle(python.cs1)
circle_2 = Circle(python.cs2)
panel = Panel(python.dist2)
panel_2 = Panel(python.dist1)
