# Grasshopper definition 005_Returning_more_than_one_thin_from_a_funciton__Calling_a_function_inside_another_function.ghx (Grasshopper 1.0.7)

# ----
# 005_Returning_more_than_one_thin_from_a_funciton__Calling_a_function_inside_another_function
python = GhPythonScript()  # -> out, returning_item_0_from_first_function, returning_item_1_from_first_function, result_second_function
# ---------- python: Python ----------
def first_function(a):
    sum = a + 1
    product = a * 2
    return sum, product

def second_function(b):
    age = first_function(23)[0] + b
    return age

returning_item_0_from_first_function = first_function(100)[0]
returning_item_1_from_first_function = first_function(100)[1]
result_second_function = second_function(1)
# ---------- end python ----------
python_2 = GhPythonScript()  # -> out, result_first_function, result_second_function
# ---------- python_2: Python ----------
def first_function(num1):
    text = "Hi, My name is " 
    sum = num1 + 1
    return sum, text

def second_function(name):
    beginning_sentence = first_function(0)[1] 
    full_sentence = beginning_sentence + name 
    return full_sentence

result_first_function = first_function(100)[0]
result_second_function = second_function("Gabriele")
# ---------- end python_2 ----------
panel = Panel(python_2.result_second_function)
panel_2 = Panel(python_2.result_first_function)
panel_3 = Panel(python.returning_item_1_from_first_function)
panel_4 = Panel(python.returning_item_0_from_first_function)
panel_5 = Panel(python.result_second_function)
