# Grasshopper definition day_1_me_tutorials.ghx (Grasshopper 1.0.7)

number_slider = Slider(1, range=0..1)
number_slider_2 = Slider(0.7, range=0..1)
pt = Point([Point(0, -39, 0), Point(8, -48, 0), Point(20, -40, 0), Point(33, -38, 0), Point(38, -46, 0)])
pt_2 = Point(<point referenced from the Rhino model>)
python = GhPythonScript()  # -> out, a
# ---------- python: Python ----------
for i in range(5):
    print i
# ---------- end python ----------
pt_3 = Point([Point(-2, -17, 0), Point(1, -23, 0), Point(6, -25, 0), Point(11, -23, 0), Point(11, -19, 0), Point(10, -11, 0), Point(12, -9, 0), Point(14, -9, 0)])
c_script = CSharpScript(ControlPoints=pt, IterationCount=Slider(1, range=1..7))  # -> Out, A
c_script_2 = CSharpScript(controlPoints=pt_2)  # -> out, A, B; inputs controlPoints: list of Point3d
# ---------- c_script_2: C# ----------
    A = controlPoints[0];
    B = 0.75 * controlPoints[0];
# ---------- end c_script_2 ----------
c_script_3 = CSharpScript(x=Slider(1, range=0..1), y=Slider(1, range=0..1), z=Slider(1, range=0..1))  # -> out, A, B; inputs x: Double, y: Double, z: Double
# ---------- c_script_3: C# ----------
    A = x + y;
    B = x + y + z;
# ---------- end c_script_3 ----------
c_script_4 = CSharpScript(a=number_slider, b=number_slider_2)  # -> out, A; inputs a: Double, b: Double
# ---------- c_script_4: C# ----------
    if (a > b)
    {
      Print("a is bigger than b");
    }
    else
    {
      Print("b is bigger than a");
    }
# ---------- end c_script_4 ----------
c_script_5 = CSharpScript(a=number_slider, b=number_slider_2)  # -> out, A; inputs a: Double, b: Double; same code as c_script_4
c_script_6 = CSharpScript()  # -> out, A
# ---------- c_script_6: C# ----------
    Point3d myPoint = new Point3d(1.0, 2.0, 3.0);
    A = myPoint;
# ---------- end c_script_6 ----------
panel = Panel(python.out)
# foreach
c_script_7 = CSharpScript(points=pt_3)  # -> out, A; inputs points: list of Point3d
# ---------- c_script_7: C# ----------
    List<Circle> circles = new List<Circle>();

    foreach (Point3d p in points)
    {
      Circle c = new Circle(p, 2.0);
      circles.Add(c);
    }

    A = circles;
# ---------- end c_script_7 ----------
c_script_8 = CSharpScript()  # -> out, A
# ---------- c_script_8: C# ----------
    List<Point3d> myPoints = new List<Point3d>();
    myPoints.Add(new Point3d(0.0, 0.0, 3.0));

    A = myPoints;
# ---------- end c_script_8 ----------
c_script_9 = CSharpScript()  # -> out, A
# ---------- c_script_9: C# ----------
    List<Point3d> myPoints = new List<Point3d>();

    for (int i = 0; i < 15; i++)
    {
      Point3d point = new Point3d(0.0, 0.3, i * 2);
      myPoints.Add(point);
    }

    A = myPoints;

    //simpler version

    //List<Point3d> myPoints = new List<Point3d>();

    //for (int i = 0; i < 15; i++)
    //{

    //  myPoints.Add(new Point3d(0.0, 0.3, i * 2));
    //}

    //A = myPoints;
# ---------- end c_script_9 ----------
c_script_10 = CSharpScript()  # -> out, A
# ---------- c_script_10: C# ----------
    List<Point3d> myList = new List<Point3d>(){};
    
    for (int i = 0; i < 4; i++)
    {
      for (int j = 3; j < 10; j++)
      {
       for (int z = 0; z < 23; z++)
          myList.Add(new Point3d(i, j, z));
      }
    }
    
    A = myList;
# ---------- end c_script_10 ----------
panel_2 = Panel(c_script_3.A)
panel_3 = Panel(c_script_3.B)
panel_4 = Panel(c_script_4.out)
c_script_11 = CSharpScript()  # -> out, A
# ---------- c_script_11: C# ----------
    for (int i = 0; i < 5; i++)
    {
      Print(i.ToString());
    }
# ---------- end c_script_11 ----------
c_script_12 = CSharpScript()  # -> out, myList
# ---------- c_script_12: C# ----------
    List<double> myList = new List<double>(){0.5, 3.14};
    Print(myList.ToString());
# ---------- end c_script_12 ----------
panel_5 = Panel(c_script_2.A)
panel_6 = Panel(c_script_2.B)
panel_7 = Panel(c_script_8.A)
panel_8 = Panel(c_script_11.out)
panel_9 = Panel(c_script_12.myList)
