# Grasshopper definition convert_rhino_mesh_into_compas_mesh.ghx (Grasshopper 1.0.7)

# ----
# convert rhino mesh into compas mesh
mesh = Mesh(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)
python = GhPythonScript(r_mesh=mesh)  # inputs r_mesh: Mesh
# ---------- python: Python ----------
import compas
from compas.datastructures import Mesh
from compas_rhino import conversions

wrapper_mesh = conversions.RhinoMesh.from_geometry(r_mesh)

c_mesh = wrapper_mesh.to_compas()

data = c_mesh.to_data()

#data = wrapper_mesh.to_compas().to_data()

json_mesh = compas.json_dump(data, "C:/_GABRIELE/ETH/_DIDATTICA/III/WORK/Print Path Design/12_07_2022/aa.json", pretty=True)
# ---------- end python ----------
