# Grasshopper definition test_gh.ghx (Grasshopper 1.0.7)

number_slider = Slider(2.5, range=0..10)
python = GhPythonScript()  # -> out, a
# ---------- python: Python ----------
from compas.datastructures import Mesh


mesh = Mesh()

a = mesh.add_vertex()  # x,y,z coordinates are optional and default to 0,0,0
b = mesh.add_vertex(x=1)
c = mesh.add_vertex(x=1, y=1)
d = mesh.add_vertex(y=1)

mesh.add_face([a, b, c, d])


a = mesh
# ---------- end python ----------
python_2 = GhPythonScript()  # -> out, a
# ---------- python_2: Python ----------
import os
import sys
from compas_rhino import unload_modules

currentdir = os.path.dirname(os.path.realpath(ghdoc.Path)) # gets the current directory
sys.path.append(currentdir) # temporarily append this scripts directory to the path

print currentdir

from test_to_text import *
unload_modules('test_to_text')
#t = test(1)
#print(t)

from test_to_text import Pt

P = Pt('hello')
P.print_text()


#currentdir = os.path.dirname(os.path.realpath(ghdoc.Path)) # gets the current directory
#parentdir = os.path.dirname(currentdir) # gets the parent directory of current
#parentdir = os.path.dirname(parentdir) # get the parent of parent directory
#dire = os.path.join(parentdir, 'scripts') # point to the 'scripts' directory
#sys.path.append(dire) # temporarily append this scripts directory to the path
# ---------- end python_2 ----------
python_3 = GhPythonScript(valuex=number_slider, valuey=number_slider, valuez=number_slider)  # -> out, pt
# ---------- python_3: Python ----------
import os
import sys
from compas_rhino import unload_modules

currentdir = os.path.dirname(os.path.realpath(ghdoc.Path)) # gets the current directory
sys.path.append(currentdir) # temporarily append this scripts directory to the path

import imp
imp.reload(test_CW)

from test_CW import *



#currentdir = os.path.dirname(os.path.realpath(ghdoc.Path)) # gets the current directory
#parentdir = os.path.dirname(currentdir) # gets the parent directory of current
#parentdir = os.path.dirname(parentdir) # get the parent of parent directory
#dire = os.path.join(parentdir, 'scripts') # point to the 'scripts' directory
#sys.path.append(dire) # temporarily append this scripts directory to the path
# ---------- end python_3 ----------
python_4 = GhPythonScript(valuex=number_slider, valuey=number_slider, valuez=number_slider)  # -> out, pt
# ---------- python_4: Python ----------
import os
import sys
from compas_rhino import unload_modules

currentdir = os.path.dirname(os.path.realpath(ghdoc.Path)) # gets the current directory
sys.path.append(currentdir) # temporarily append this scripts directory to the path


from test_CW import *



#currentdir = os.path.dirname(os.path.realpath(ghdoc.Path)) # gets the current directory
#parentdir = os.path.dirname(currentdir) # gets the parent directory of current
#parentdir = os.path.dirname(parentdir) # get the parent of parent directory
#dire = os.path.join(parentdir, 'scripts') # point to the 'scripts' directory
#sys.path.append(dire) # temporarily append this scripts directory to the path
# ---------- end python_4 ----------
draw = Draw(cg=python.a)  # -> rg
#   port cg: The COMPAS geometry or datastructure to be drawn.
#   port rg: The Rhino geometry object.
# ---------- draw: Python ----------
"""
Draws COMPAS geometry in Grasshopper.
"""
from ghpythonlib.componentbase import executingcomponent as component

from compas.artists import Artist


class CompasToRhinoGeometry(component):
    def RunScript(self, cg):
        if not cg:
            return None

        return Artist(cg).draw()
# ---------- end draw ----------
